# Grasshopper definition masterscript.gh (Grasshopper 1.0.7)
# plug-ins: MetaHopper, Hops

# ---- group: Hard-Coded Input
# Given a version number MAJOR.MINOR.PATCH, increment the:
# 
# MAJOR version when you make incompatible API changes,
# MINOR version when you add functionality in a backwards compatible manner, and
# PATCH version when you make backwards compatible bug fixes.
# 
# Additional labels for pre-release and build metadata are available as extensions
# to the MAJOR.MINOR.PATCH format.
# 
# more info: https://semver.org/spec/v2.0.0.html
txt_message = Panel("Don't mess with me")

geo_input = Curve([<curve referenced from the Rhino model> x18])

# ---- group: User Input (Optional)
type_descriptivename = Slider(0.05, range=0..0.1)

# ---- group: User Input (Must Use)
geo_input_2 = Curve([<curve referenced from the Rhino model> x18])

# ---- group: User Action (Must Use)
# Code Information: Author:
# Contact:
# 
# Date:
# Project:
button = Button()

# ----
# Key
# Faint Wires between Groups
txt_message_2 = Data(txt_message)
geo_input_3 = Curve(geo_input)

# ----
# Description of
# Group Function
geo_input_4 = Curve(geo_input_3)
txt_message_3 = Data(txt_message_2)
# Goal: Note for future development of code.  Express as an action to complete
move = Move(Geometry=geo_input_4, Motion=Vector(0, 0, 10))  # -> Geometry, Transform

# ---- group: Data/Geo to Check
txt_message_4 = Panel(txt_message_3)

# ---- group: To Output
geo_input_moved = Curve(move.Geometry)

# ----
# Output: Scopes
# (maybe show multiple buildings with different settings)
panel = Panel("Massing")
# Code Description: Master Script controlling project
# 
# 1.0.0 - Project framework
# Master Script
panel_2 = Panel("tasks\Massing.gh")
relpath = RelativePath(Path=panel_2)
hops = Hops(
    _Path=relpath,
    TaskID="Task01",
    Radius=Slider(60, range=0..100),
    Height=Slider(100, range=0..100),
    CacheResultsInMemory=True,
    CacheSolveResults=True,
    RemoteDefinitionLocation="C:\Users\jkamm\Dropbox\devhops\hops\tasks\Massing.gh",
    RemoteSolveVersion=(0, 1, 0),
    ShowInput_Enabled=False,
    ShowInput_Path=True,
    SynchronousSolve=True)
# DevHops comonent
# Placeholder for DevHops component
relpath_2 = RelativePath(Path="tasks\Panelization.gh")
hops_2 = Hops(
    _Path=relpath_2,
    TaskID="Task02",
    IntFaceCountUPerSrf=Slider(4, range=0..10),
    BrepMass=hops,
    CacheResultsInMemory=True,
    CacheSolveResults=True,
    RemoteDefinitionLocation="C:\Users\jkamm\Dropbox\devhops\hops\tasks\Panelization.gh",
    RemoteSolveVersion=(0, 1, 0),
    ShowInput_Enabled=False,
    ShowInput_Path=True,
    SynchronousSolve=True)
relpath_3 = RelativePath(Path="tasks\SubStructures.gh")
# Link to kanban?
# Export to images
panel_3 = Panel("tasks\Patterning.gh")
# outputs:
# data stats
# Visualization
# Texture maps
hops_3 = Hops(
    _Path=relpath_3,
    TaskID="Task02",
    SrfPanelsByScope=hops_2,
    NumPipeRadius=Slider(0.4, range=0..1),
    BrepMass=hops,
    CacheResultsInMemory=True,
    CacheSolveResults=True,
    RemoteDefinitionLocation="C:\Users\jkamm\Dropbox\devhops\hops\tasks\SubStructures.gh",
    RemoteSolveVersion=(0, 1, 0),
    ShowInput_Enabled=False,
    ShowInput_Path=True,
    SynchronousSolve=True)  # -> CrvMullionPipes, BrepMullionPipes
panel_4 = Panel("Patterning")
# outputs:
# data stats
# Visualization
# Texture maps
# Extract Data for Estimation
# inputs:
# Pipe Curves
# Panels
# Pattern elements: number of perforation? Surface area of paint?
panel_5 = Panel("inputs")
relpath_4 = RelativePath(Path=panel_3)
# Combined model for Rendering Resource?
# inputs:
# Pipe Curves
# Panels
# Pattern elements: number of perforation? Surface area of paint?
# outputs:
# data stats
# Visualization
# Texture maps
hops_4 = Hops(
    _Path=relpath_4,
    TaskID="Task03",
    SrfPanelsByScope=hops_2,
    CacheResultsInMemory=True,
    CacheSolveResults=True,
    RemoteDefinitionLocation="C:\Users\jkamm\Dropbox\devhops\hops\tasks\Patterning.gh",
    RemoteSolveVersion=(0, 1, 0),
    ShowInput_Enabled=False,
    ShowInput_Path=True,
    SynchronousSolve=True)
